# Grasshopper definition arch497-02-SP19-gcode-formatter-01.gh (Grasshopper 1.0.5)

crv = Curve(<curve referenced from the Rhino model>)
divlength = DivideLength(Curve=crv, Length=Slider(2, range=0..10))  # -> Points, Tangents, Parameters
pline = PolyLine(Vertices=divlength.Points, Closed=False)
cp = ControlPoints(Curve=pline)  # -> Points, Weights, Knots
pdecon = Deconstruct(Point=cp.Points)  # -> XComponent, YComponent, ZComponent
expression = Expression(
    x=pdecon.XComponent,
    y=pdecon.YComponent,
    z=pdecon.ZComponent,
    Expression="Format(\"G1 X{0:0.00} Y{1:0.00} F30.0\", x, y, Z)")  # -> flatten(R)
panel = Panel("""G0 Z1.0
M5
M30""")
panel_2 = Panel("""(My First Program)
G0 G17 G20 G40 G80 G90
X0.0 Y0.0
(S10000 M3)
Z0.5
G1 Z0.0 F15.0""")
# Right-Click and select "Copy Data Only"
panel_3 = Panel([panel_2, expression, panel])
