# Grasshopper definition class-03.gh (Grasshopper 1.0.5)

range = Range(Domain=Domain(0, 1), Steps=10)
number_slider = Slider(9, range=0..10)
number_slider_2 = Slider(12, range=0..100)
hexgrid = Hexagonal(Plane=PlaneXY(0, 0, 0), Size=number_slider, ExtentX=number_slider_2, ExtentY=number_slider_2)  # -> Cells, Points
series = Series(Start=0, Step=number_slider, Count=number_slider_2)
pdecon = Deconstruct(Point=flatten(hexgrid.Points))  # -> XComponent, YComponent, ZComponent
series_2 = Series(Start=0, Step=number_slider, Count=number_slider_2)
crossref = CrossReference(ListA=series, ListB=series_2, CrossMode=1)  # -> ListA, ListB
crv = Curve([<curve referenced from the Rhino model> x2])
viewer = ParamViewer(crv)
panel = Panel(series)
panel_2 = Panel(series_2)
pt = ConstructPoint(XCoordinate=pdecon.XComponent, YCoordinate=pdecon.YComponent, ZCoordinate=0)
cpoly = ControlPolygon(Curve=crv)  # -> Polygon, Points
area = Area(Geometry=crv)  # -> Area, Centroid
pt_2 = Point(<point referenced from the Rhino model>)
division = Division(A=number_slider, B=2)
pcen = PolygonCenter(Polyline=cpoly.Polygon)  # -> CenterV, CenterE, CenterA
dist = Distance(PointA=pt_2, PointB=pt)
subtraction = Subtraction(A=division, B=Slider(0.231, range=0..1))
vec2pt = Vector2Pt(PointA=area.Centroid, PointB=pt, Unitize=False)  # -> Vector, Length
bnd = Bounds(Numbers=dist)
dom = ConstructDomain(DomainStart=Slider(0, range=0..10), DomainEnd=subtraction)
vdis = VectorDisplay(Anchor=pcen.CenterV, Vector=vec2pt.Vector)
move = Move(Geometry=crv, Motion=vec2pt.Vector)  # -> Geometry, Transform
remap = RemapNumbers(Value=dist, Source=bnd, Target=dom)  # -> Mapped, Clipped
scale = Scale(Geometry=move.Geometry, Center=pt, Factor=remap.Mapped)  # -> Geometry, Transform
circle = CircleCNR(Center=pt, Normal=Vector(0, 0, 1), Radius=remap.Mapped)
panel_3 = Panel(dist)
