# Grasshopper definition image mapper.gh (Grasshopper 1.0.5)

# Brett Balogh
# Summer 2019
# 
# This definition samples images and transforms circles
number_slider = Slider(5.4, range=0..10)
number_slider_2 = Slider(32, range=0..1000)
sqgrid = Square(Plane=PlaneXY(0, 0, 0), Size=number_slider, ExtentX=number_slider_2, ExtentY=number_slider_2)  # -> Cells, flatten(Points)
image = ImageSampler(
    <missing>,
    FilePath="C:\Users\Student\Desktop\index.jpg",
    Filter="Value",
    Interpolate=True,
    Umax=225,
    Umin=1,
    Vmax=225,
    Vmin=1,
    Wrap=1)
multiplication = Multiplication(A=image, B=Slider(3.6, range=0..10))
circle = CircleCNR(Center=sqgrid.Points, Normal=Vector(0, 0, 1), Radius=multiplication)
panel = Panel(image)
