# Grasshopper definition bb-array.gh (Grasshopper 1.0.7)

number_slider = Slider(4.088, range=0..10)
number_slider_2 = Slider(2.265, range=0..10)
neg = Negative(Value=number_slider_2)
neg_2 = Negative(Value=number_slider)
dom = ConstructDomain(DomainStart=neg, DomainEnd=number_slider_2)
dom_2 = ConstructDomain(DomainStart=neg_2, DomainEnd=number_slider)
pt = ConstructPoint(XCoordinate=0, YCoordinate=0, ZCoordinate=0)
series = Series(Start=0, Step=Slider(18, range=0..100), Count=Slider(18, range=0..100))
series_2 = Series(Start=0, Step=Slider(18, range=0..100), Count=Slider(18, range=0..100))
rectangle = Rectangle(Plane=PlaneXY(0, 0, 0), XSize=dom_2, YSize=dom, Radius=0)  # -> Rectangle, Length
Y = UnitY(Factor=series_2)
X = UnitX(Factor=series)
move = Move(Geometry=rectangle.Rectangle, Motion=X)  # -> graft(Geometry), Transform
move_2 = Move(Geometry=move.Geometry, Motion=Y)  # -> Geometry, Transform
item = ListItem(List=move_2.Geometry, Index=Slider(13, range=0..100), Wrap=False)  # -> flatten(Item)
item_2 = ListItem(List=item, Index=Slider(0, range=0..100), Wrap=True)
