# Grasshopper definition sine-demo.gh (Grasshopper 0.9.76)

series = Series(Start=Slider(90, range=0..1000), Step=1, Count=Slider(360, range=0..1000))
rad = Radians(Degrees=series)
sin = Sine(Value=rad)
multiplication = Multiplication(A=sin, B=Slider(40, range=0..100))
pt = ConstructPoint(XCoordinate=series, YCoordinate=multiplication, ZCoordinate=0)

geo = Geometry()
brep = Brep(<brep referenced from the Rhino model>)
brep_2 = Brep([<brep referenced from the Rhino model> x40])
dedom2num = DeconstructDomain²(Domain=brep)  # -> UMin, UMax, VMin, VMax
bbox = BoundingBox(Content=brep_2, Plane=PlaneXY(0, 0, 0), UnionBox=True)  # -> Box, Box_2
dom = ConstructDomain(DomainStart=dedom2num.VMin, DomainEnd=dedom2num.VMax)
dom_2 = ConstructDomain(DomainStart=dedom2num.UMin, DomainEnd=dedom2num.UMax)
dom_3 = ConstructDomain(DomainStart=0, DomainEnd=Slider(1, range=0..10))
srfmorph = SurfaceMorph(Geometry=brep_2, Reference=bbox.Box, Surface=brep, UDomain=dom_2, VDomain=dom, WDomain=dom_3)

intcrv = Interpolate(Vertices=pt, Degree=3, Periodic=False, KnotStyle=1)  # -> Curve, Length, Domain
end = EndPoints(Curve=intcrv.Curve)  # -> Start, End
rad_2 = Radians(Degrees=Slider(180, range=0..1000))
ln = Line(StartPoint=end.End, EndPoint=end.Start)
revsrf = Revolution(Curve=intcrv.Curve, Axis=ln, Domain=rad_2)

bbox_2 = BoundingBox(Content=revsrf, Plane=PlaneXY(0, 0, 0))  # -> Box, Box_2
debox = DeconstructBox(Box=bbox_2.Box)  # -> Plane, X, Y, Z
dedomain = DeconstructDomain(Domain=debox.X)  # -> Start, End
subtraction = Subtraction(A=dedomain.End, B=dedomain.Start)
series_2 = Series(Start=0, Step=subtraction, Count=Slider(5, range=0..10))
pt_2 = ConstructPoint(XCoordinate=series_2, YCoordinate=0, ZCoordinate=0)

pdecon = Deconstruct(Point=end.Start)  # -> XComponent, YComponent, ZComponent
division = Division(A=subtraction, B=2)

dedomain_2 = DeconstructDomain(Domain=debox.Y)  # -> Start, End
subtraction_2 = Subtraction(A=dedomain_2.End, B=dedomain_2.Start)
series_3 = Series(Start=0, Step=subtraction_2, Count=Slider(4, range=0..10))
pt_3 = ConstructPoint(XCoordinate=0, YCoordinate=series_3, ZCoordinate=0)
vec2pt = Vector2Pt(PointA=end.Start, PointB=pt_2, Unitize=False)  # -> Vector, Length
move = Move(Geometry=revsrf, Motion=vec2pt.Vector)  # -> graft(Geometry), Transform

pdecon_2 = Deconstruct(Point=pt_3)  # -> XComponent, YComponent, ZComponent
addition = Addition(A=pdecon_2.XComponent, B=pdecon.XComponent)
addition_2 = Addition(A=pdecon_2.YComponent, B=pdecon.YComponent)
pt_4 = ConstructPoint(XCoordinate=addition, YCoordinate=addition_2, ZCoordinate=0)

vec2pt_2 = Vector2Pt(PointA=end.Start, PointB=pt_4, Unitize=False)  # -> Vector, Length
move_2 = Move(Geometry=move.Geometry, Motion=vec2pt_2.Vector)  # -> Geometry, Transform

pdecon_3 = Deconstruct(Point=pt_4)  # -> XComponent, YComponent, ZComponent
addition_3 = Addition(A=division, B=pdecon_3.XComponent)

division_2 = Division(A=subtraction_2, B=2)

addition_4 = Addition(A=division_2, B=pdecon_3.YComponent)

pt_5 = ConstructPoint(XCoordinate=addition_3, YCoordinate=addition_4, ZCoordinate=0)
vec2pt_3 = Vector2Pt(PointA=end.Start, PointB=pt_5, Unitize=False)  # -> Vector, Length
move_3 = Move(Geometry=move_2.Geometry, Motion=vec2pt_3.Vector)  # -> Geometry, Transform
