# Grasshopper definition sine-panels.gh (Grasshopper 1.0.7)

number_slider = Slider(90, range=0..360)
addition = Addition(A=number_slider, B=360)
dom = ConstructDomain(DomainStart=number_slider, DomainEnd=addition)
range = Range(Domain=dom, Steps=Slider(24, range=0..100))
rad = Radians(Degrees=range)
sin = Sine(Value=rad)
multiplication = Multiplication(A=sin, B=Slider(42, range=0..100))
pt = ConstructPoint(XCoordinate=range, YCoordinate=multiplication, ZCoordinate=0)
lng = ListLength(List=pt)
intcrv = Interpolate(Vertices=pt, Degree=3, Periodic=False, KnotStyle=1)  # -> Curve, Length, Domain
subtraction = Subtraction(A=lng, B=1)
item = ListItem(List=pt, Index=0, Wrap=True)
item_2 = ListItem(List=pt, Index=subtraction, Wrap=True)
dom_2 = ConstructDomain(DomainStart=Slider(0, range=0..360), DomainEnd=Slider(180, range=0..360))
ln = Line(StartPoint=item_2, EndPoint=item)
rad_2 = Radians(Degrees=dom_2)
revsrf = Revolution(Curve=intcrv.Curve, Axis=ln, Domain=rad_2)
len = Length(Curve=ln)
pdecon = Deconstruct(Point=item)  # -> XComponent, YComponent, ZComponent
series = Series(Start=0, Step=len, Count=10)
brep = Brep(revsrf)
addition_2 = Addition(A=pdecon.XComponent, B=series)
pt_2 = ConstructPoint(XCoordinate=addition_2, YCoordinate=pdecon.YComponent, ZCoordinate=0)
vec2pt = Vector2Pt(PointA=item, PointB=pt_2, Unitize=False)  # -> Vector, Length
bbox = BoundingBox(Content=brep, Plane=PlaneXY(0, 0, 0))  # -> Box, Box_2
move = Move(Geometry=brep, Motion=vec2pt.Vector)  # -> graft(Geometry), Transform
debox = DeconstructBox(Box=bbox.Box)  # -> Plane, X, Y, Z
bbox_2 = BoundingBox(Content=move.Geometry, Plane=PlaneXY(0, 0, 0), UnionBox=True)  # -> Box, Box_2
dedomain = DeconstructDomain(Domain=debox.X)  # -> Start, End
dedomain_2 = DeconstructDomain(Domain=debox.Y)  # -> Start, End
debox_2 = DeconstructBox(Box=bbox_2.Box)  # -> Plane, X, Y, Z
subtraction_2 = Subtraction(A=dedomain.End, B=dedomain.Start)
subtraction_3 = Subtraction(A=dedomain_2.End, B=dedomain_2.Start)
dedomain_3 = DeconstructDomain(Domain=debox_2.Y)  # -> Start, End
division = Division(A=subtraction_2, B=2)
division_2 = Division(A=subtraction_3, B=2)
subtraction_4 = Subtraction(A=dedomain_3.End, B=dedomain_3.Start)
series_2 = Series(Start=0, Step=subtraction_4, Count=10)
Y = UnitY(Factor=series_2)
move_2 = Move(Geometry=move.Geometry, Motion=Y)  # -> graft(Geometry), Transform
vec = VectorXYZ(XComponent=division, YComponent=division_2, ZComponent=0)  # -> Vector, Length
brep_2 = Brep(<brep referenced from the Rhino model>)
move_3 = Move(Geometry=move_2.Geometry, Motion=vec.Vector)  # -> Geometry, Transform
dedom2num = DeconstructDomain²(Domain=brep_2)  # -> UMin, UMax, VMin, VMax
merge = Merge(Data1=move_2.Geometry, Data2=move_3.Geometry)
dom_3 = ConstructDomain(DomainStart=dedom2num.UMin, DomainEnd=dedom2num.UMax)
dom_4 = ConstructDomain(DomainStart=0, DomainEnd=1)
dom_5 = ConstructDomain(DomainStart=dedom2num.VMin, DomainEnd=dedom2num.VMax)
bbox_3 = BoundingBox(Content=flatten(merge), Plane=PlaneXY(0, 0, 0), UnionBox=True)  # -> Box, Box_2
srfmorph = SurfaceMorph(Geometry=merge, Reference=bbox_3.Box, Surface=brep_2, UDomain=dom_3, VDomain=dom_5, WDomain=dom_4)
