# Grasshopper definition halftone-drill-gcode.gh (Grasshopper 0.9.76)

number_slider = Slider(19, range=0..100)
ball_diameter = Slider(0.5, range=0..1)
number_slider_2 = Slider(12, range=0..100)
list = ValueList({"INCHES": "G20", "MM": "G21"}, selected="INCHES")
feedrate = Slider(100, range=0..100)
txt = Text(["M5", "M30"])
list_2 = ValueList({"CW": "M3", "CCW": "M4"}, selected="CW")
crv = Curve(<curve referenced from the Rhino model>)
txt_2 = Text("G0 G17 G80 G90")
Z = UnitZ(Factor=Slider(-0.5, range=-1..1))
extr = Extrude(Base=crv, Direction=Z)
multiplication = Multiplication(A=number_slider, B=number_slider_2)
drec = DeconstuctRectangle(Rectangle=crv)  # -> BasePlane, XInterval, YInterval
cap = CapHoles(Brep=extr)
division = Division(A=ball_diameter, B=2)
dom = ConstructDomain(DomainStart=0, DomainEnd=10)
range = Range(Domain=drec.YInterval, Steps=number_slider_2)
range_2 = Range(Domain=drec.XInterval, Steps=number_slider)
neg = Negative(Value=division)
random = Random(Range=dom, Number=multiplication, Seed=2)
crossref = CrossReference(ListA=range_2, ListB=range, CrossMode=1)  # -> ListA, ListB
bnd = Bounds(Numbers=<missing>)
dom_2 = ConstructDomain(DomainStart=0, DomainEnd=neg)
pt = ConstructPoint(XCoordinate=crossref.ListA, YCoordinate=crossref.ListB, ZCoordinate=0)
remap = RemapNumbers(Value=<missing>, Source=bnd, Target=dom_2)  # -> Mapped, Clipped
pt_2 = ConstructPoint(XCoordinate=crossref.ListA, YCoordinate=crossref.ListB, ZCoordinate=remap.Mapped)
split = SplitList(List=pt_2, Index=1)  # -> ListA, ListB
pdecon = Deconstruct(Point=split.ListB)  # -> XComponent, YComponent, ZComponent
pdecon_2 = Deconstruct(Point=split.ListA)  # -> XComponent, YComponent, ZComponent
expression = Expression(d=ball_diameter, h=remap.Mapped, Expression="sqrt((d/2)²-((d/2)+h)²)")
pdecon_3 = Deconstruct(Point=pt_2)  # -> XComponent, YComponent, ZComponent
expression_2 = Expression(
    x=pdecon.XComponent,
    y=pdecon.YComponent,
    z=pdecon.ZComponent,
    Expression="Format(\"X{0:0.00} Y{1:0.00} Z{2:0.00}\", x, y,z)")
expression_3 = Expression(
    x=pdecon_2.XComponent,
    y=pdecon_2.YComponent,
    z=pdecon_2.ZComponent,
    f=feedrate,
    Expression="Format(\"G81 X{0:0.00} Y{1:0.00} Z{2:0.00} F{3:0.00}\", x,y,z,f)")
pt_3 = ConstructPoint(XCoordinate=pdecon_3.XComponent, YCoordinate=pdecon_3.YComponent, ZCoordinate=0)
circle = CircleCNR(Center=pt_3, Normal=Vector(0, 0, 1), Radius=expression)
bnd_2 = Bounds(Numbers=expression)
sph = Sphere(Base=pt_3, Radius=expression)
sdiff = SolidDifference(BrepsA=cap, BrepsB=sph)
panel = Panel(expression_2)
panel_2 = Panel(txt)
panel_3 = Panel(list_2)
panel_4 = Panel(expression_3)
panel_5 = Panel(list)
panel_6 = Panel(txt_2)
entwine = Entwine(
    Branch00=panel_6,
    Branch01=panel_5,
    Branch02=panel_3,
    Branch03=panel_4,
    Branch04=panel,
    Branch05=panel_2,
    FlattenInputs=True)
panel_7 = Panel(entwine)
